# Grasshopper definition Grasshopper Game.gh (Grasshopper 1.0.7)
# plug-ins: Shader Nodes

construct_point = ConstructPoint(XCoordinate=0, YCoordinate=0, ZCoordinate=0)

# ---- group: RH_IN:size
number_slider = Slider(53, range=0..100)

# ----
polygon = Polygon(Plane=construct_point, Radius=number_slider, Segments=Slider(4, range=1..10), FilletRadius=0)  # -> Polygon, Length
radians = Radians(Degrees=Slider(45, range=0..100))
rotate = Rotate(Geometry=polygon.Polygon, Angle=radians, Plane=PlaneXY(0, 0, 0))  # -> Geometry, Transform
boundary_surfaces = BoundarySurfaces(Edges=rotate.Geometry)
number_slider_2 = Slider(19, range=1..25)
divide_domain² = DivideDomain²(Domain=boundary_surfaces, UCount=number_slider_2, VCount=number_slider_2)
isotrim = Isotrim(Surface=boundary_surfaces, Domain=divide_domain²)  # -> graft(Surface)
list_item = ListItem(List=divide_domain², Index=0, Wrap=True)
deconstruct_domain = DeconstructDomain(Domain=list_item)  # -> Start, End
deconstruct_domain² = DeconstructDomain²(Domain=list_item)  # -> UComponent, VComponent
number_slider_3 = Slider(4.02, range=0..10)
divide_domain = DivideDomain(Domain=deconstruct_domain².UComponent, Count=Slider(2, range=0..10))
series = Series(Start=0, Step=number_slider_3, Count=Slider(11, range=0..100))
unit_z = UnitZ(Factor=series)
division = Division(A=number_slider_3, B=Slider(2, range=0..10))
move = Move(Geometry=isotrim, Motion=unit_z)  # -> Geometry, Transform
area = Area(Geometry=move.Geometry)  # -> Area, flatten(Centroid)
center_box = CenterBox(Base=area.Centroid, X=divide_domain, Y=divide_domain, Z=division)
unit_z_2 = UnitZ(Factor=division)
move_2 = Move(Geometry=center_box, Motion=unit_z_2)  # -> Geometry, Transform
move_3 = Move(Geometry=move_2.Geometry, Motion=unit_z_2)  # -> Geometry, Transform

# ---- group: RH_IN:density
number_slider_4 = Slider(500, range=500..1000)

# ----
bounding_box = BoundingBox(Content=move_3.Geometry, Plane=PlaneXY(0, 0, 0), UnionBox=True)  # -> Box, Box_2
populate_3d = Populate3D(Region=bounding_box.Box, Count=number_slider_4, Seed=1)
deconstruct = Deconstruct(Point=populate_3d)  # -> XComponent, YComponent, ZComponent
bounds = Bounds(Numbers=deconstruct.ZComponent)

# ---- group: RH_IN:randomize
number_slider_5 = Slider(69, range=0..100)

# ----
remap_numbers = RemapNumbers(Value=deconstruct.ZComponent, Source=bounds, Target=Domain(0, 1))  # -> Mapped, Clipped
random = Random(Range=Domain(0, 1), Number=number_slider_5, Seed=2)
larger_than = LargerThan(FirstNumber=remap_numbers.Mapped, SecondNumber=random)  # -> LargerThan, OrEqualTo
cull_pattern = CullPattern(List=populate_3d, CullPattern=larger_than.LargerThan)

# ---- group: RH_IN:randomreduce
number_slider_6 = Slider(400, range=0..1000)

# ----
list_length = ListLength(List=cull_pattern)
multiply = Multiply(Value1=list_length, Value2=Slider(0.5, range=0..1), UseClamp=False)
random_reduce = RandomReduce(List=cull_pattern, Reduction=multiply, Seed=number_slider_6)
project = Project(Geometry=random_reduce, Plane=PlaneXY(0, 0, 0))  # -> Geometry, Transform
list_length_2 = ListLength(List=random_reduce)

# ---- group: RH_IN:pipe
number_slider_7 = Slider(0.5, range=0..1)

# ----
construct_domain = ConstructDomain(DomainStart=0, DomainEnd=Slider(8, range=0..10))
line = Line(StartPoint=random_reduce, EndPoint=project.Geometry)
random_2 = Random(Range=construct_domain, Number=list_length_2, Seed=2)
pipe = Pipe(Curve=line, Radius=number_slider_7, Caps=0)
sphere = Sphere(Base=random_reduce, Radius=random_2)
pull_point = PullPoint(Point=area.Centroid, Geometry=sphere, ClosestOnly=True)  # -> ClosestPoint, Distance
larger_than_2 = LargerThan(FirstNumber=pull_point.Distance, SecondNumber=Slider(5, range=0..10))  # -> LargerThan, OrEqualTo
cull_pattern_2 = CullPattern(List=move_3.Geometry, CullPattern=larger_than_2.LargerThan)
custom_preview = CustomPreview(Geometry=cull_pattern_2, Material=ColourSwatch(SwatchColor=RGB(255, 255, 255)))
mesh_brep = MeshBrep(
    Brep=cull_pattern_2,
    Settings={GridMaxCount=0, GridMinCount=16, JaggedSeams=False, MaxEdgeLength=0, MinEdgeLength=0.0001, MinTolerance=0, Refine=True, RefineAngle=0, RelativeTolerance=0.65, SimplePlanes=True, Tolerance=0})

# ---- group: RH_OUT:meshCubes
geometry = Geometry(mesh_brep)

# ----
custom_preview_2 = CustomPreview(Geometry=sphere, Material=ColourSwatch(SwatchColor=RGB(0, 252, 114)))
custom_preview_3 = CustomPreview(Geometry=pipe, Material=ColourSwatch(SwatchColor=RGB(0, 13, 6)))
mesh_brep_2 = MeshBrep(
    Brep=sphere,
    Settings={GridMaxCount=0, GridMinCount=16, JaggedSeams=False, MaxEdgeLength=0, MinEdgeLength=0.0001, MinTolerance=0, Refine=True, RefineAngle=0, RelativeTolerance=0.65, SimplePlanes=True, Tolerance=0})

# ---- group: RH_OUT:meshSphere
mesh = Mesh(mesh_brep_2)
